# Grasshopper definition assigment_01a.gh (Grasshopper 1.0.7)
# plug-ins: Human

text = Text(["'Bitcoin'", "'Ethereum'", "'BNB'", "'Tether'", "'Solana'", "'USD Coin'"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])
number = Number([42712.54145, 3265.678125, 480.4655894, 1.000400801, 147.5606662, 0.9994876998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])
list_length = ListLength(List=number)
ghpython_script = GhPythonScript(x=text)  # -> out, a
# ---------- ghpython_script: Python ----------
a = x.replace("'","")
# ---------- end ghpython_script ----------

start = GetInteger(Slider(0, range=0..499), AtLeast=1, AtMost=1, Maximum=2147483647, Minimum=-2147483648)
step = GetInteger(Slider(37, range=0..499), AtLeast=1, AtMost=1, Maximum=2147483647, Minimum=-2147483648)
count = GetInteger(Slider(4, range=0..499), AtLeast=1, AtMost=1, Maximum=2147483647, Minimum=-2147483648)
series = Series(Start=start, Step=step, Count=count)

# ---- group: RH_OUT:coinmarketcap
panel = Panel("https://coinmarketcap.com/")

# ----
list_item = ListItem(List=number, Index=series, Wrap=True)
list_item_2 = ListItem(List=ghpython_script.a, Index=series, Wrap=True)

# ---- group: RH_OUT:_values_20220113
concatenate = Concatenate(Fragment_A=list_item_2, Fragment_B=list_item, A="'USD'", JoinSeparator=",")

# ----
seed = GetInteger(Slider(0, range=0..1000), AtLeast=1, AtMost=1, Maximum=2147483647, Minimum=-2147483648)
radians = Radians(Degrees=Slider(90, range=0..90))

domain = GetNumber(Slider(17.647, range=0..100), AtLeast=1, AtMost=1, Maximum=1.797693135e+308, Minimum=-1.797693135e+308)

negative = Negative(Value=domain)
construct_domain = ConstructDomain(DomainStart=domain, DomainEnd=negative)
rectangle = Rectangle(Plane=PlaneXY(0, 0, 0), XSize=construct_domain, YSize=construct_domain, Radius=0)  # -> Rectangle, Length
populate_3d = Populate3D(Region=rectangle.Rectangle, Count=list_length, Seed=seed)
yz_plane = YZPlane(Origin=populate_3d)
line_sdl = LineSDL(Start=populate_3d, Direction=Vector(0, 0, 1), Length=number)
rotate_plane = RotatePlane(Plane=yz_plane, Angle=radians)

# ---- group: RH_OUT:_Location
list_item_3 = ListItem(List=rotate_plane, Index=series, Wrap=True)

# ---- group: RH_OUT:line
list_item_4 = ListItem(List=line_sdl, Index=series, Wrap=True)

# ----
custom_preview_lineweights = CustomPreviewLineweights(
    Geometry=list_item_4,
    Shader=ColourSwatch(SwatchColor=RGB(115, 255, 0)),
    Thickness=Slider(3, range=0..10),
    Absolute=False)

# ---- group: RH_OUT:text
text_tag_3d = TextTag3D(Location=list_item_3, Text=concatenate, Size=1, Colour=ColourSwatch(SwatchColor=RGB(0, 0, 0)), Justification=7)
